# Requirement set NGOs (R2024b)

## 1 [Navigate Various Terrain]
The drone will be exposed to various elements. It would Be best to condition it to thrive in various terrains and weather conditions.

### 1.1 [Urban Pavemnt]
Concrete, sidewalks, potholes, etc.

### 1.2 [Woods]
Dirt, sticks, logs, leaves, etc.

### 1.3 [Beach Land]
Sand, gravel, Wet splashes, salted air, etc.

### 1.4 [Sandy and Beach Areas]
Sand, Gravel, water splashes, etc.

## 2 [Detect Enemy Vehicle]
The drone must be able to identify and locate enemy vehicles.

### 2.1 [Detect Vehicles]
The drone must distinguish the difference between a car and everything else. The can is slated to be red, which can make distinguishing easier or more difficult.

### 2.2 [Detect Enemy vehicle's precise location]
The drone must be able to track objects' relative and absolute (global) position

### 2.3 [Mimimize Comprmization]
We want to be able to observe without being observed

## 3 [Navigate Autonomously]
Autonomous navigation creates synergies between man and machine; the goal should not be for another person to control the drone remotely.

### 3.1 [Understand its Global Position]
The drone should be able to know where it is in the world

### 3.2 [Relative Localization]
The drone should be able to understand its immediate surroundings

### 3.3 [Autonomous Path Planning]
The drone should be able to chart its path in various environments

## 4 [Efficient Time Use]
Setup and breakdown should not make or break a mission

### 4.1 [Quick Pelooyment time]

### 4.2 [40 Min Battery operation time]

### 4.3 [Quick retreat and pack up methodology]